# Dynamo graph dynamo1file.dyn (Dynamo 0.7.1.2932)

string = StringInput("C:\Users\Erick\Desktop\ADSK\ReferenceFiles\RoofPanels-subtle.xlsx")
string_2 = StringInput("Sheet1")
read = Excel.Read(string, string_2)
number = DoubleInput(0)
code_block = CodeBlock(excelOutput=read, pointOfInterest=number) { ExcelPoints(excelOutput,pointOfInterest); }
byPoints = Polygon.ByPoints(code_block)
byPatch = Surface.ByPatch(byPoints)
family_types = FamilyTypes(index=100)
byPoints_2 = AdaptiveComponent.ByPoints(arg1=family_types)
code_block_2 = CodeBlock()
# ---------- code_block_2.designscript (9 lines) ----------
def ExcelPoints(x,pointIndex)
{
pointValues=List.GetItemAtIndex(String.ToNumber(String.Split(List.Transpose(x),",")),pointIndex);
pointItems=List.Transpose(pointValues);
px=List.GetItemAtIndex(pointItems,0);
py=List.GetItemAtIndex(pointItems,1);
pz=List.GetItemAtIndex(pointItems,2);
return=Point.ByCoordinates(px,py,pz);
}
# ----------------------------------------
