# Dynamo graph python_nodes.dyn (Dynamo 2.16.1.2727)

python_script = Python()  # CPython3; unwired: IN[0]
# ---------- python_script.python (16 lines) ----------
# Load the Python Standard and DesignScript Libraries
import sys
import clr
clr.AddReference('ProtoGeometry')
from Autodesk.DesignScript.Geometry import *

# The inputs to this node will be stored as a list in the IN variables.
dataEnteringNode = IN


#Not renamed, Cpython3

# Place your code below this line

# Assign your output to the OUT variable.
OUT = sys.version
# ----------------------------------------
renamed_cpython = Python()  # CPython3; unwired: IN[0]
# ---------- renamed_cpython.python (20 lines) ----------
"""
Multiline comment 
blablabla
"""

# Load the Python Standard and DesignScript Libraries
import sys
import clr
clr.AddReference('ProtoGeometry')
from Autodesk.DesignScript.Geometry import *

# The inputs to this node will be stored as a list in the IN variables.
dataEnteringNode = IN

#Renamed, Cpython3

# Place your code below this line

# Assign your output to the OUT variable.
OUT = 0
# ----------------------------------------
python_script_2 = Python()  # IronPython2; unwired: IN[0]
# ---------- python_script_2.python (15 lines) ----------
# Load the Python Standard and DesignScript Libraries
import sys
import clr
clr.AddReference('ProtoGeometry')
from Autodesk.DesignScript.Geometry import *

# The inputs to this node will be stored as a list in the IN variables.
dataEnteringNode = IN

#Not renamed, IronPython2

# Place your code below this line

# Assign your output to the OUT variable.
OUT = sys.version
# ----------------------------------------
python = Python()  # CPython3; unwired: IN[0]; starter script, not edited (OUT = 0)
code_block = CodeBlock { <>:"/\|?* }  # unwired: h
python_2 = Python()  # CPython3; unwired: IN[0]; starter script, not edited (OUT = 0)
python_script_renamed = Python()  # IronPython2; unwired: IN[0]; same code as python_script_2
