# Dynamo graph single_node.dyn (Dynamo 2.17.0.3472)

python_script = Python()  # CPython3; unwired: IN[0]
# ---------- python_script.python (17 lines) ----------
# Load the Python Standard and DesignScript Libraries
import sys
import clr
clr.AddReference('ProtoGeometry')
from Autodesk.DesignScript.Geometry import *

# The inputs to this node will be stored as a list in the IN variables.
dataEnteringNode = IN

output = {
    "python_version": sys.version,
    "asd_string": "asd_string"
}


# Assign your output to the OUT variable.
OUT = output
# ----------------------------------------
